# Dynamo graph Rooms Extractor.dyn (Dynamo 3.6.2.11575)

file_path = Filename("C:\Users\heny\Desktop\building_data.json")  # frozen
categories = Categories("OST_Rooms")  # frozen
all_elements_of_category = ElementsOfCategory(Category=categories)  # frozen
categories_2 = Categories("OST_Planting")  # frozen
all_elements_of_category_2 = ElementsOfCategory(Category=categories_2)  # frozen
python_script = Python(IN[0]=all_elements_of_category, IN[1]=all_elements_of_category_2)  # CPython3; frozen
# ---------- python_script.python (96 lines) ----------
import clr
import json

# Import Revit API
clr.AddReference('RevitAPI')
from Autodesk.Revit.DB import *

clr.AddReference('RevitServices')
from RevitServices.Persistence import DocumentManager

doc = DocumentManager.Instance.CurrentDBDocument

# Unwrap Dynamo elements
rooms = UnwrapElement(IN[0]) if isinstance(IN[0], list) else [UnwrapElement(IN[0])]
furniture_list = UnwrapElement(IN[1]) if isinstance(IN[1], list) else [UnwrapElement(IN[1])]

building_dataset = {
    "building": {
        "id": "toronto_building_01",
        "name": "Toronto Tower",
        "floors": 12,
        "levels": []
    }
}

level_dict = {}

# 1. Process Rooms
for room in rooms:
    if not room or room.Area == 0:  # Skip unplaced or unbounded rooms
        continue
        
    level_name = room.Level.Name if room.Level else "Level 01"
    room_id = room.UniqueId
    room_number = room.Number
    room_name = room.get_Parameter(BuiltInParameter.ROOM_NAME).AsString()
    room_area = round(room.Area * 0.092903, 2)  # Sq.Ft to Sq.Meters
    
    if level_name not in level_dict:
        level_dict[level_name] = {
            "id": level_name.replace(" ", "_"),
            "name": level_name,
            "rooms": []
        }
        
    # Find furniture located inside this room using spatial/phase check safely
    room_assets = []
    for furn in furniture_list:
        if not furn:
            continue
        
        # Safe extraction for CPython3
        furn_room = None
        try:
            # Check phase-assigned room safely
            phase = doc.GetElement(furn.CreatedPhaseId)
            if hasattr(furn, 'get_Room'):
                furn_room = furn.get_Room(phase)
            elif hasattr(furn, 'Room'):
                furn_room = furn.Room
        except:
            pass

        if furn_room and furn_room.UniqueId == room_id:
            # Extract Shared Parameters safely
            param_data = {}
            for param in furn.Parameters:
                if param.IsShared and param.HasValue:
                    val = param.AsString()
                    if not val:
                        val = str(round(param.AsDouble(), 2))
                    param_data[param.Definition.Name] = val
            
            fam_name = furn.Symbol.Family.Name if hasattr(furn, 'Symbol') else "Generic"
            
            room_assets.append({
                "id": furn.UniqueId,
                "family": fam_name,
                "type": furn.Name,
                "shared_parameters": param_data
            })

    level_dict[level_name]["rooms"].append({
        "id": room_id,
        "number": room_number,
        "name": room_name,
        "area_sqm": room_area,
        "camera": { "eye": [0, 0, 0], "target": [0, 0, 0] },
        "assets": room_assets
    })

# Format into output dictionary
for lvl in level_dict.values():
    building_dataset["building"]["levels"].append(lvl)

OUT = json.dumps(building_dataset, indent=2)
# ----------------------------------------
writeText = FileSystem.WriteText(filePath=file_path, text=python_script)  # frozen
views = Views("RoomView")
python_script_2 = Python(IN[0]=views)  # CPython3
# ---------- python_script_2.python (25 lines) ----------
import clr
clr.AddReference('RevitAPI')
from Autodesk.Revit.DB import *

view3d = UnwrapElement(IN[0])

if isinstance(view3d, View3D) and view3d.IsPerspective:
    # Extract Camera Orientation
    orientation = view3d.GetOrientation()
    
    # Converts Revit Internal Feet to Meters for WebGL (Three.js)
    eye = [round(orientation.EyePosition.X * 0.3048, 2), 
           round(orientation.EyePosition.Y * 0.3048, 2), 
           round(orientation.EyePosition.Z * 0.3048, 2)]
           
    forward_vector = orientation.ForwardDirection
    
    # Calculate target point 5 meters in front of the camera direction
    target = [round(eye[0] + forward_vector.X * 5.0, 2),
              round(eye[1] + forward_vector.Y * 5.0, 2),
              round(eye[2] + forward_vector.Z * 5.0, 2)]

    OUT = { "eye": eye, "target": target }
else:
    OUT = "Selected View is not a 3D Perspective Camera View."
# ----------------------------------------
